# Dynamo graph Piano_Jan26.dyn (Dynamo 3.3.0.6316)

# group: Black keys
code_block = CodeBlock { Math.Round((0.55..#13..1.1)+0.5, 2); }
code_block_2 = CodeBlock(i=code_block)
# ---------- code_block_2.designscript (4 lines) ----------
[i[0],i[2], i[3], i[5], i[6], i[7],
i[9], i[10], i[12]];
4;
1;
# ----------------------------------------
byCoordinates = Point.ByCoordinates(x=code_block_2.out0, y=code_block_2.out1, z=code_block_2.out2)
code_block_3 = CodeBlock { 0.75; 4; }
byLengths = Cuboid.ByLengths(origin=byCoordinates, width=code_block_3.out0, length=code_block_3.out1)
code_block_4 = CodeBlock { 225; 50; }
byARGB = Color.ByARGB(alpha=code_block_4.out0, red=code_block_4.out1, green=code_block_4.out1, blue=code_block_4.out1)
byGeometryColor = Modifiers.GeometryColor.ByGeometryColor(geometry=byLengths, color=byARGB)

# group: White keys
code_block_5 = CodeBlock { Math.Round((0.55..#14..1.1), 2); }
code_block_6 = CodeBlock { 3; 0.5; }
byCoordinates_2 = Point.ByCoordinates(x=code_block_5, y=code_block_6.out0, z=code_block_6.out1)
code_block_7 = CodeBlock { 6; }
byLengths_2 = Cuboid.ByLengths(origin=byCoordinates_2, length=code_block_7)
code_block_8 = CodeBlock { 225; }
byARGB_2 = Color.ByARGB(alpha=code_block_8, red=code_block_8, green=code_block_8, blue=code_block_8)
byGeometryColor_2 = Modifiers.GeometryColor.ByGeometryColor(geometry=byLengths_2, color=byARGB_2)

# group: Date time NOW
# Play on periodic
now = DateTime.Now()
code_block_9 = CodeBlock(t=now) { Dictionary.ValueAtKey(DateTime.Components(t), "second"); }

# group: Pick a note
python_script = Python(IN[0]=code_block_9)  # CPython3
# ---------- python_script.python (24 lines) ----------
import clr
clr.AddReference("RevitAPI")
from Autodesk.Revit.Exceptions import OperationCanceledException
clr.AddReference("RevitAPIUI")
from Autodesk.Revit.UI.Selection import ObjectType
clr.AddReference("RevitServices")
from RevitServices.Persistence import DocumentManager
clr.AddReference("RevitNodes")
import Revit
clr.ImportExtensions(Revit.Elements)

doc   = DocumentManager.Instance.CurrentDBDocument
uidoc = DocumentManager.Instance.CurrentUIApplication.ActiveUIDocument
sel   = uidoc.Selection

# One click pick. ESC not required
try:
    r = sel.PickObject(ObjectType.Element, "Pick one element")
    el = doc.GetElement(r.ElementId)
    OUT = el.ToDSType(True) if el else "moose"
except OperationCanceledException:
    OUT = "moose"
except:
    OUT = "moose"
# ----------------------------------------
code_block_10 = CodeBlock { "Mark"; }
getParameterValueByName = Element.GetParameterValueByName(element=python_script, parameterName=code_block_10)

# group: The sound
# Read wav file
# note: Open this node and update the wav folder location.
# Windows sound only lets you play wav files saved on your local machine.
# note: Instructions :
# 1 - Download the Revit file - It's Revit 2025
# 2 - Download wav folder and save on local machine.
# 3 - Open the play selected note node and update the folder location (just type between the " " )
# 4 - Put Dynamo on periodic mode.
# 5 - Play
py_play_selected_note = Python(IN[0]=getParameterValueByName)  # CPython3
# ---------- py_play_selected_note.python (18 lines) ----------
import winsound
import time
import os

r"ENTER THE FOLDER WHERE YOU HAVE SAVED YOUR WAV FILES"

note = IN[0] 

wav_file = os.path.join(folder_path, note)

if os.path.exists(wav_file):
    winsound.PlaySound(
        wav_file,
        winsound.SND_FILENAME | winsound.SND_ASYNC
    )
    OUT = "Played: " + wav_file
else:
    OUT = "Lots of moose"
# ----------------------------------------

# group: Keyboard - colour in Dynamo
# because - why not?
code_block_11 = CodeBlock(w=byLengths_2, b=byLengths) { [w , b]; }
flatten = List.Flatten(list=code_block_11)
python_script_2 = Python(IN[0]=getParameterValueByName, IN[1]=flatten)  # CPython3
# ---------- python_script_2.python (20 lines) ----------
import os

played = IN[0]
DynoKeys = IN[1]

note = os.path.splitext(played)[0]

notes = [
    # White keys
    "A", "B", "C", "D", "E", "F", "G",
    "A_high", "B_high", "C_high", "D_high", "E_high", "F_high", "G_high",

    # Black keys
    "AS", "CS", "DS", "FS", "GS",
    "AS_high", "CS_high", "DS_high", "FS_high"
]

index = notes.index(note) if note in notes else "moose"

OUT = DynoKeys[index]
# ----------------------------------------
color_palette = ColorPalette({R: 255, G: 64, B: 0, A: 255})
byGeometryColor_3 = Modifiers.GeometryColor.ByGeometryColor(geometry=python_script_2, color=color_palette)
