# Dynamo graph PlaySounds.dyn (Dynamo 3.3.0.6316)

middle_c = StringInput("R:\revit\dynamo\WIP\Laura\2025\Sound")
python_script = Python(IN[0]=middle_c)  # CPython3; frozen
# ---------- python_script.python (105 lines) ----------
import winsound
import time
import os

folder_path = r"R:\revit\dynamo\WIP\Laura\2025\Sound"

notes = [
    # pickupj
    "D.wav",
    # bar 1 (G): D | G . F# G B
    "G.wav","FS.wav","G.wav","B_high.wav",
    # bar 2 (D): A . G A B
    "A_high.wav","G.wav","A_high.wav","B_high.wav",
    # bar 3 (G): G . A B D
    "G.wav","G.wav","B_high.wav","D_high.wav",
    # bar 4 (C): E(hold)  D
    "E_high.wav","E_high.wav" ,

    # bar 5 (G): D . B B G
    "D_high.wav","B_high.wav","B_high.wav","G.wav",
    # bar 6 (D7): A . G A B  A
    "A_high.wav","G.wav","A_high.wav","B_high.wav","A_high.wav",
    # bar 7 (E-): G . E E D
    "G.wav","E.wav","E.wav","D.wav",
    # bar 8 (G): G(hold) D
    "G.wav","E_high.wav",

    # bar 9 (G): D . B B G
    "D_high.wav","B_high.wav","B_high.wav","G.wav",
    # bar 10 (D7): A . G A E
    "A_high.wav","G.wav","A_high.wav","E_high.wav",
    # bar 11 (G): D . B B D
    "D_high.wav","B_high.wav","B_high.wav","D_high.wav",
    # bar 12 (C): E(hold) D
    "E_high.wav","E_high.wav",

    # bar 13 (G): D . B B G
    "D_high.wav","B_high.wav","B_high.wav","G.wav",
    # bar 14 (D7): A . G A B  A
    "A_high.wav","G.wav","A_high.wav","B_high.wav","A_high.wav",
    # bar 15 (E-): G . E E D
    "G.wav","E.wav","E.wav","D.wav",
    # bar 16 (G): G(hold)
    "G.wav"
]

beat = 0.22  # 1 quaver (8th note)

# dotted crotchet=3, quaver=1, crotchet=2, dotted minim=6, minim=4
durations = [
    # pickup
    beat*2,
    # bar 1 (3,1,2,2)
    beat*3, beat*1, beat*2, beat*2,
    # bar 2 (3,1,2,2)
    beat*3, beat*1, beat*2, beat*2,
    # bar 3 (3,1,2,2)
    beat*3, beat*1, beat*2, beat*2,
    # bar 4 (6,2)
    beat*6, beat*2,

    # bar 5 (3,1,2,2)
    beat*3, beat*1, beat*2, beat*2,
    # bar 6 (3,1,2,1,1)
    beat*3, beat*1, beat*2, beat*1, beat*1,
    # bar 7 (3,1,2,2)
    beat*3, beat*1, beat*2, beat*2,
    # bar 8 (6,2)
    beat*6, beat*2,

    # bar 9 (3,1,2,2)
    beat*3, beat*1, beat*2, beat*2,
    # bar 10 (3,1,2,2)
    beat*3, beat*1, beat*2, beat*2,
    # bar 11 (3,1,2,2)
    beat*3, beat*1, beat*2, beat*2,
    # bar 12 (6,2)
    beat*6, beat*2,

    # bar 13 (3,1,2,2)
    beat*3, beat*1, beat*2, beat*2,
    # bar 14 (3,1,2,1,1)
    beat*3, beat*1, beat*2, beat*1, beat*1,
    # bar 15 (3,1,2,2)
    beat*3, beat*1, beat*2, beat*2,
    # bar 16 (8)
    beat*8
]

# Safety check
if len(notes) != len(durations):
    OUT = "ERROR: notes ({}) and durations ({}) length mismatch".format(len(notes), len(durations))
else:
    for note, dur in zip(notes, durations):
        wav_file = os.path.join(folder_path, note)

        # Play asynchronously so we can control duration
        winsound.PlaySound(wav_file, winsound.SND_FILENAME | winsound.SND_ASYNC)

        time.sleep(dur)

        # Stop the current sound before next note (prevents overlap tails)
        #winsound.PlaySound(None, winsound.SND_PURGE)

    OUT = "Played (full): " + ", ".join(notes)
# ----------------------------------------

# group: Black keys
code_block = CodeBlock { Math.Round((0.55..#11..1.1)+1.6, 2); }
code_block_2 = CodeBlock(i=code_block)
# ---------- code_block_2.designscript (4 lines) ----------
[i[0],i[1], i[3], i[4], i[5], i[7],
i[8]];
4;
1;
# ----------------------------------------
byCoordinates = Point.ByCoordinates(x=code_block_2.out0, y=code_block_2.out1, z=code_block_2.out2)
code_block_3 = CodeBlock { 0.75; 4; }
byLengths = Cuboid.ByLengths(origin=byCoordinates, width=code_block_3.out0, length=code_block_3.out1)
byARGB = Color.ByARGB()
byGeometryColor = Modifiers.GeometryColor.ByGeometryColor(geometry=byLengths, color=byARGB)

# group: White keys
code_block_4 = CodeBlock { Math.Round((0.55..#11..1.1), 2); }
code_block_5 = CodeBlock { 3; 0.5; }
byCoordinates_2 = Point.ByCoordinates(x=code_block_4, y=code_block_5.out0, z=code_block_5.out1)
code_block_6 = CodeBlock { 6; }
byLengths_2 = Cuboid.ByLengths(origin=byCoordinates_2, length=code_block_6)

now = DateTime.Now()
python_script_2 = Python(IN[0]=byLengths_2, IN[1]=now)  # CPython3
# ---------- python_script_2.python (50 lines) ----------
import clr
clr.AddReference("ProtoGeometry")
from Autodesk.DesignScript.Geometry import *
clr.AddReference("System.Windows.Forms")
from System.Windows.Forms import Cursor

# Get cuboids from Dynamo input
cuboids = IN[0]

# Function to calculate centroid from Bounding Box
def get_centroid(cuboid):
    bbox = cuboid.BoundingBox
    min_pt = bbox.MinPoint
    max_pt = bbox.MaxPoint
    centroid_x = (min_pt.X + max_pt.X) / 2
    centroid_y = (min_pt.Y + max_pt.Y) / 2
    centroid_z = (min_pt.Z + max_pt.Z) / 2
    return Point.ByCoordinates(centroid_x, centroid_y, centroid_z)

# Extract centroids
cuboid_centroids = [get_centroid(c) for c in cuboids]

# Get mouse screen position
mouse_pos = Cursor.Position
mouse_x, mouse_y = mouse_pos.X, mouse_pos.Y

# Function to approximate screen to Dynamo space (Assumes uniform scaling)
def screen_to_dynamo(x, y, screen_width=1920, screen_height=1080, dynamo_width=100, dynamo_height=100):
    dynamo_x = (x / screen_width) * dynamo_width
    dynamo_y = ((screen_height - y) / screen_height) * dynamo_height  # Invert Y
    return dynamo_x, dynamo_y

# Convert screen position to estimated Dynamo space
dyn_x, dyn_y = screen_to_dynamo(mouse_x, mouse_y)

# Find the closest cuboid based on 2D distance (X and Y)
def closest_cuboid():
    min_distance = float("inf")
    closest_index = -1
    for i, centroid in enumerate(cuboid_centroids):
        distance = ((dyn_x - centroid.X) ** 2 + (dyn_y - centroid.Y) ** 2) ** 0.5  # Euclidean distance
        if distance < min_distance:
            min_distance = distance
            closest_index = i
    return closest_index

clicked_cuboid_index = closest_cuboid()

# Output the detected cuboid
OUT = f"Clicked on Cuboid {clicked_cuboid_index + 1}" if clicked_cuboid_index != -1 else "No cuboid detected"
# ----------------------------------------
code_block_7 = CodeBlock { false; }
watchCopy = Custom[WatchCopy](Thing2Read=byCoordinates_2, Show_index=code_block_7)  # Lets you cut the info
